# Grasshopper definition getStdDim.gh (Grasshopper 1.0.7)
# plug-ins: Volvox

# To be upgraded with automatic dim generator
crv = Curve([<curve referenced from the Rhino model> x15])
item = ListItem(List=crv, Index=0, Wrap=True)  # -> Item, Item1, Item2, Item3, Item4, Item5, Item6, Item7, Item8, Item9
crv_2 = Curve([item.Item2, item.Item1, item.Item9, item.Item7])
panel = Panel("C:\Users\garo\PycharmProjects\cloudTutorial\")
curvepoint = PointOnCurve(crv_2, parameter=0.5)
len = Length(Curve=crv_2)
end = EndPoints(Curve=crv_2)  # -> Start, End
pt = Point(end.End)
convert = ConvertXyz(Run=True)  # -> Log, FilePath
panel_2 = Panel(curvepoint)
panel_3 = Panel(len)
pt_2 = Point(end.Start)
pdecon = Deconstruct(Point=pt)  # -> XComponent, YComponent, ZComponent
panel_4 = Panel("clou1")
pdecon_2 = Deconstruct(Point=pt_2)  # -> XComponent, YComponent, ZComponent
toggle = BooleanToggle(True)
round = Round(Number=pdecon.YComponent)  # -> Nearest, Floor, Ceiling
round_2 = Round(Number=pdecon.ZComponent)  # -> Nearest, Floor, Ceiling
round_3 = Round(Number=pdecon.XComponent)  # -> Nearest, Floor, Ceiling
round_4 = Round(Number=pdecon_2.ZComponent)  # -> Nearest, Floor, Ceiling
round_5 = Round(Number=pdecon_2.XComponent)  # -> Nearest, Floor, Ceiling
round_6 = Round(Number=pdecon_2.YComponent)  # -> Nearest, Floor, Ceiling
graft = GraftTree(Tree=round_5.Nearest, IncludeEmptyLists=True, IncludeNullItems=True)
graft_2 = GraftTree(Tree=round_3.Nearest, IncludeEmptyLists=True, IncludeNullItems=True)
graft_3 = GraftTree(Tree=round_2.Nearest, IncludeEmptyLists=True, IncludeNullItems=True)
graft_4 = GraftTree(Tree=round_6.Nearest, IncludeEmptyLists=True, IncludeNullItems=True)
graft_5 = GraftTree(Tree=round.Nearest, IncludeEmptyLists=True, IncludeNullItems=True)
graft_6 = GraftTree(Tree=round_4.Nearest, IncludeEmptyLists=True, IncludeNullItems=True)
concat = Concatenate(FragmentA=graft_2, FragmentB=" ", FragmentC=graft_5, FragmentD=" ", FragmentE=graft_3)  # -> simplify(flatten(Result))
concat_2 = Concatenate(FragmentA=graft, FragmentB=" ", FragmentC=graft_4, FragmentD=" ", FragmentE=graft_6)  # -> simplify(flatten(Result))
export_robotmotion_3_r3_multi = PythonScript(toggle=Toggle(True), path="C:\Users\garo\PycharmProjects\cloudTutorial\cloud1", x=concat_2)  # inputs x: list
# ---------- export_robotmotion_3_r3_multi: Python ----------
#script by Gabriella Rossi / CITA
import os
from os import listdir
from os.path import isfile, join
from scriptcontext import sticky as st

if True:
    #Create file
    filename = str(path) + ".xyz"
    fil = open(filename, 'w')
    
    i = 0
    #Write in the file
    for line in x:
        if i < 1:
            print("first")
            lineS = str(line)
            fil.write(lineS)
            i += 1
        else:
            print i
            lineS = str(line)
            fil.write('\n' +lineS)
            i += 1
    fil.close()
# ---------- end export_robotmotion_3_r3_multi ----------
export_robotmotion_3_r3_multi_2 = PythonScript(toggle=Toggle(True), path="C:\Users\garo\PycharmProjects\cloudTutorial\cloud2", x=concat)  # inputs x: list; same code as export_robotmotion_3_r3_multi
